# Grasshopper definition 3d scanning.gh (Grasshopper 1.0.7)

_3d_scanned_mesh = Mesh([<mesh referenced from the Rhino model> x15])
pl = ConstructPlane(Origin=Point(0, 0, 0), XAxis=Vector(1, 0, 0), YAxis=Vector(0, 1, 0))
number_slider = Slider(40, range=0..100)
neg = Negative(Value=number_slider)
dom = ConstructDomain(DomainStart=neg, DomainEnd=number_slider)
X = UnitX(Factor=[Slider(-14, range=-100..-12), Slider(12, range=0..20)])
rectangle = Rectangle(Plane=pl, XSize=dom, YSize=dom, Radius=0)  # -> Rectangle, Length
move = Move(Geometry=pl, Motion=X)  # -> Geometry, Transform
srf = Surface(rectangle.Rectangle)
Z = UnitZ(Factor=Slider(33, range=0..100))
move_2 = Move(Geometry=srf, Motion=Z)  # -> Geometry, Transform
move_3 = Move(Geometry=move.Geometry, Motion=Z)  # -> Geometry, Transform
Z_2 = UnitZ(Factor=Slider(3, range=0..100))
move_4 = Move(Geometry=move_2.Geometry, Motion=Z_2)  # -> Geometry, Transform
move_5 = Move(Geometry=move_3.Geometry, Motion=Z_2)  # -> Geometry, Transform
item = ListItem(List=move_5.Geometry, Index=0, Wrap=True)
item_2 = ListItem(List=move_5.Geometry, Index=-1, Wrap=True)
mjoin = MeshJoin(Meshes=_3d_scanned_mesh)
X_2 = UnitX(Factor=Slider(-5, range=-10..0))
move_6 = Move(Geometry=item_2, Motion=X_2)  # -> Geometry, Transform
weld = WeldMesh(Mesh=mjoin, Angle=3.141592654)
srf_2 = Surface(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)
Z_3 = UnitZ(Factor=Slider(2, range=0..100))
move_7 = Move(Geometry=move_6.Geometry, Motion=Z_3)  # -> Geometry, Transform
msplit = MeshSplit(Mesh=weld, Splitters=graft(srf))

# ---- group: elements mesh
number_slider_2 = Slider(0, range=0..10)
item_3 = ListItem(List=msplit, Index=number_slider_2, Wrap=True)
cull_i = CullIndex(List=msplit, Indices=number_slider_2, Wrap=True)
mjoin_2 = MeshJoin(Meshes=cull_i)
bbox = BoundingBox(Content=mjoin_2, Plane=PlaneXY(0, 0, 0))  # -> Box, Box_2

# ----
msplit_2 = MeshSplit(Mesh=item_3, Splitters=graft([srf, move_2.Geometry]))
item_4 = ListItem(List=flatten(msplit_2), Index=Slider(3, range=0..10), Wrap=True)
msplit_3 = MeshSplit(Mesh=item_4, Splitters=graft([move_4.Geometry, move_2.Geometry]))
item_5 = ListItem(List=flatten(msplit_3), Index=Slider(0, range=0..8), Wrap=True)
msplit_4 = MeshSplit(Mesh=item_5, Splitters=graft(srf_2))

# ---- group: elements mesh
item_6 = ListItem(List=flatten(msplit_2), Index=Slider(1, range=0..10), Wrap=True)
item_7 = ListItem(List=flatten(msplit_2), Index=Slider(9, range=0..10), Wrap=True)

item_8 = ListItem(List=flatten(msplit_3), Index=Slider(1, range=0..7), Wrap=True)

item_9 = ListItem(List=flatten(msplit_4), Index=0, Wrap=True)
item_10 = ListItem(List=flatten(msplit_4), Index=Slider(1, range=0..1), Wrap=True)

# ----
brep = Brep([<brep referenced from the Rhino model> x6])

# ---- group: planes
pln = Plane([move.Geometry, move_3.Geometry, item, move_6.Geometry, move_7.Geometry])
